# Grasshopper definition dev_all_charts.gh (Grasshopper 1.0.7)
# plug-ins: Hops, Human, Telepathy, MetaHopper

toggle = BooleanToggle(True)
list = ValueList({"LONDON": 0, "NEW_YORK": 1, "SYDNEY": 2, "MEDELLIN": 3, "BERLIN": 4}, selected="MEDELLIN")

# ---- group: implement...
set_theme = GhPythonScript(style="dark")  # -> set_theme
# ---------- set_theme: Python ----------
"""Provides a scripting component.
    Inputs:
        context: Changes figure sizing default='notebook', 'papaer', 'talk', 'poster'
        style: Axes style parameter 'darkgrid', 'dark', 'ticks', 'whitegrid', 'white'
        palette: Color palette
        font: Font family, see matplotlib font manager
        font_scale: Separate scaling factor to independently scale the size of the font elements.
    Output:
        set_theme: The a output variable"""

__author__ = "pablo"
__version__ = "2022.09.05"


import Grasshopper.Kernel.Data as ghp
import Grasshopper.DataTree as ghdt
import Grasshopper as gh
import json

def check_types(item):
    if str(item).isdigit():
        item = int(item)
    elif item.replace('.', '', 1).isdigit() and item.count('.') < 2:
        item = float(item)
    elif item == 'True' or item == 'true':
        item = True
    elif item == 'False' or item == 'false':
        item = False
    else:
        item = str(item)
    
    return item

names = []
values = []

for input in ghenv.Component.Params.Input:
    for s in input.Sources:
        names.append(input.Name)
        attr = s.Attributes
        if (attr is None) or (attr.GetTopLevel is None):
            pass
        else:
            component = attr.GetTopLevel.DocObject
#            print input.Name
#            print component.NickName
            if type(component) is gh.Kernel.Special.GH_NumberSlider:
#                print component.Slider.Value
                values.append(int(component.Slider.Value))
            elif type(component) is gh.Kernel.Special.GH_Panel:
#                print component.UserText
                values.append(component.UserText)
            elif type(component) is gh.Kernel.Special.GH_BooleanToggle:
#                print component.Value
                values.append(component.Value)
#            component.ExpireSolution(True)

print names
dict = {k:check_types(str(v)) for k,v in zip(names, values)}

print [type(v) for k,v in dict.items()]
print dict

set_theme = json.dumps(dict)
# ---------- end set_theme ----------
set_theme_2 = RemoteSender(set_theme)

# ----
cluster = Cluster(city=list)
relpath = RelativePath(Path="example-weather-data.csv")
# Data is a csv format with a '@' as liine terminator
file = ReadFile(File=relpath, PerLineParse=True)
# Common Axis Arguments: title(str)
# xlabel(str)
# ylabel(str)
# xticks(tick)
# yticks(ticks)
# grid(bool)
# xlim([min, max])
# ylim([min, max])
# xscale(str): (e.g., 'linear' or 'log')
# yscale(str): (e.g., 'linear' or 'log')
panel = Panel("{\"title\" : \"My Custom Title\", \"xlabel\" : \"X label\" , \"ylabel\" : \"Y label\", \"xlim\" : [0, 35], \"xticks\" : [0, 10, 20 , 30]}")
local_development = Panel("http://127.0.0.1:8000/")
# Server: https://seaborn-grasshopper-dev.onrender.com/
# Server: https://seaborn-grasshopper.onrender.com/
local_development_2 = Panel("http://127.0.0.1:5000/")
item = ListItem(List=file, Index=0, Wrap=True)
join = TextJoin(Text=file, Join="@")
split = TextSplit(Text=item, Separators=",")
# Sample Data Contains
# the following columns
# - hour
# - season
# - drybulb
# - direct_normal_radiation
update = Button()
add_args = GhPythonScript(height="4", aspect="1.5")  # -> add_args
# ---------- add_args: Python ----------
import Grasshopper.Kernel.Data as ghp
import Grasshopper.DataTree as ghdt
import Grasshopper as gh
import json

names = []
values = []

def check_types(item):
    if str(item).isdigit():
        item = int(item)
    elif item.replace('.', '', 1).isdigit() and item.count('.') < 2:
        item = float(item)
    elif item == 'True' or item == 'true':
        item = True
    elif item == 'False' or item == 'false':
        item = False
    else:
        item = str(item)
    
    return item


for input in ghenv.Component.Params.Input:
    for s in input.Sources:
        names.append(input.Name)
        attr = s.Attributes
        if (attr is None) or (attr.GetTopLevel is None):
            pass
        else:
            component = attr.GetTopLevel.DocObject
#            print input.Name
#            print component.NickName
            if type(component) is gh.Kernel.Special.GH_NumberSlider:
#                print component.Slider.Value
                values.append(int(component.Slider.Value))
            elif type(component) is gh.Kernel.Special.GH_Panel:
#                print component.UserText
                values.append(component.UserText)
            elif type(component) is gh.Kernel.Special.GH_BooleanToggle:
#                print component.Value
                values.append(component.Value)
#            component.ExpireSolution(True)

print names

dict = {k:check_types(str(v)) for k,v in zip(names, values)}

print [type(v) for k,v in dict.items()]
print dict

add_args = json.dumps(dict)
# ---------- end add_args ----------
despine = GhPythonScript(top=Toggle(True), offset=Slider(5, range=0..10))  # -> despine; inputs top: Boolean, right: Boolean, left: Boolean, bottom: Boolean, trim: Boolean
# ---------- despine: Python ----------
import Grasshopper.Kernel.Data as ghp
import Grasshopper.DataTree as ghdt
import Grasshopper as gh
import json

def check_types(item):
    if str(item).isdigit():
        item = int(item)
    elif item.replace('.', '', 1).isdigit() and item.count('.') < 2:
        item = float(item)
    elif item == 'True' or item == 'true':
        item = True
    elif item == 'False' or item == 'false':
        item = False
    else:
        item = str(item)
    
    return item

names = []
values = []

for input in ghenv.Component.Params.Input:
    for s in input.Sources:
        names.append(input.Name)
        attr = s.Attributes
        if (attr is None) or (attr.GetTopLevel is None):
            pass
        else:
            component = attr.GetTopLevel.DocObject
#            print input.Name
#            print component.NickName
            if type(component) is gh.Kernel.Special.GH_NumberSlider:
#                print component.Slider.Value
                values.append(int(component.Slider.Value))
            elif type(component) is gh.Kernel.Special.GH_Panel:
#                print component.UserText
                values.append(component.UserText)
            elif type(component) is gh.Kernel.Special.GH_BooleanToggle:
#                print component.Value
                values.append(component.Value)
#            component.ExpireSolution(True)

print names
dict = {k:check_types(str(v)) for k,v in zip(names, values)}
print [type(v) for k,v in dict.items()]
print dict

despine = json.dumps(dict)
# ---------- end despine ----------
headers = Panel(split)
csv_str = Text(join)
# PABLO ARANGO
# Computational Developer / Environmental Designer
# https://www.linkedin.com/in/monsieurpablo/
# Seaborn-gh based on the initial release of Hops_plots by Maes Antoine
# 
# Connects Grasshopper with a CPython web server to utilize Seaborn and Matplotlib.
# 
# The server is running on a free dyno, so it might not be available in the future.
c_script = CSharpScript(delete=update)  # inputs delete: Boolean
# ---------- c_script: C# usings ----------
using System.Linq;
# ---------- c_script: C# ----------
    if(delete)
    {
      var doc = this.Component.OnPingDocument();
      if(doc == null)return;
      var objs = doc.Objects;
      var deleteComs = objs.Where(o => o.GetType().ToString() == "Grasshopper.Kernel.Components.GH_PlaceholderComponent").ToList();
      if(deleteComs == null || deleteComs.Count == 0)return;
      doc.ScheduleSolution(20, (d) => doc.RemoveObjects(deleteComs, false));
    }
# ---------- end c_script ----------
data = RemoteSender(csv_str)
address = RemoteSender(local_development)

list_2 = ValueList({"anagrams", "anscombe", "attention", "brain_networks", "car_crashes", "diamonds", "dots", "dowjones", "exercise", "flights", "fmri", "geyser", "glue", "healthexp", "iris", "mpg", "penguins", "planets", "seaice", "taxis", "tips", "titanic"}, selected="diamonds")
address_2 = RemoteReceiver(address)
concat = Concatenate(FragmentA=address_2, FragmentB="example_data")
hops = Hops(
    _Path=concat,
    CacheResultsInMemory=True,
    CacheSolveResults=True,
    RemoteDefinitionLocation="http://127.0.0.1:8000/example_data",
    RemoteSolveVersion=(0, 1, 0),
    ShowInput_Enabled=False,
    ShowInput_Path=True,
    SynchronousSolve=True)

address_3 = RemoteReceiver(address)
concat_2 = Concatenate(FragmentA=address_3, FragmentB="presets")
hops_2 = Hops(
    _Path=concat_2,
    PlotTypes="categorical",
    PaletteTypes="default",
    CacheResultsInMemory=True,
    CacheSolveResults=True,
    RemoteDefinitionLocation="http://127.0.0.1:8000/presets",
    RemoteSolveVersion=(0, 1, 0),
    ShowInput_Enabled=False,
    ShowInput_Path=True,
    SynchronousSolve=True)  # -> AvailablePlots, AvailablePalettes

fig_size = RemoteSender("10;5")
ax_args = RemoteSender(panel)
despine_2 = RemoteSender(despine)
panel_2 = Panel("frequency")

# ---- group: run.
toggle_2 = BooleanToggle(False)

toggle_3 = BooleanToggle(False)

toggle_4 = BooleanToggle(False)

toggle_5 = BooleanToggle(True)

toggle_6 = BooleanToggle(True)

toggle_7 = BooleanToggle(False)

toggle_8 = BooleanToggle(False)

toggle_9 = BooleanToggle(False)

toggle_10 = BooleanToggle(False)

# ----
data_2 = Data()
# AXIS
# LEVEL
data_3 = Data()

list_3 = ValueList({"catplot", "stripplot", "swarmplot", "boxplot", "violinplot", "boxenplot", "pointplot", "barplot", "countplot", "displot", "histplot", "kdeplot", "lineplot", "relplot", "scatterplot"}, selected="stripplot")
list_4 = ValueList({"catplot", "stripplot", "swarmplot", "boxplot", "violinplot", "boxenplot", "pointplot", "barplot", "countplot", "displot", "histplot", "kdeplot", "lineplot", "relplot", "scatterplot"}, selected="swarmplot")
list_5 = ValueList({"catplot", "stripplot", "swarmplot", "boxplot", "violinplot", "boxenplot", "pointplot", "barplot", "countplot", "displot", "histplot", "kdeplot", "lineplot", "relplot", "scatterplot"}, selected="boxplot")
list_6 = ValueList({"catplot", "stripplot", "swarmplot", "boxplot", "violinplot", "boxenplot", "pointplot", "barplot", "countplot", "displot", "histplot", "kdeplot", "lineplot", "relplot", "scatterplot"}, selected="violinplot")
list_7 = ValueList({"catplot", "stripplot", "swarmplot", "boxplot", "violinplot", "boxenplot", "pointplot", "barplot", "countplot", "displot", "histplot", "kdeplot", "lineplot", "relplot", "scatterplot"}, selected="boxenplot")
list_8 = ValueList({"catplot", "stripplot", "swarmplot", "boxplot", "violinplot", "boxenplot", "pointplot", "barplot", "countplot", "displot", "histplot", "kdeplot", "lineplot", "relplot", "scatterplot"}, selected="pointplot")
list_9 = ValueList({"catplot", "stripplot", "swarmplot", "boxplot", "violinplot", "boxenplot", "pointplot", "barplot", "countplot", "displot", "histplot", "kdeplot", "lineplot", "relplot", "scatterplot"}, selected="barplot")
list_10 = ValueList({"catplot", "stripplot", "swarmplot", "boxplot", "violinplot", "boxenplot", "pointplot", "barplot", "countplot", "displot", "histplot", "kdeplot", "lineplot", "relplot", "scatterplot"}, selected="countplot")
list_11 = ValueList({"catplot", "stripplot", "swarmplot", "boxplot", "violinplot", "boxenplot", "pointplot", "barplot", "countplot", "displot", "histplot", "kdeplot", "lineplot", "relplot", "scatterplot", "pairplot", "jointplot"}, selected="catplot")
panel_10 = Panel("drybulb")
address_4 = RemoteReceiver(address)
# CATEGORICAL
address_5 = RemoteReceiver(address)
despine_3 = RemoteReceiver(despine_2)
address_6 = RemoteReceiver(address)
address_7 = RemoteReceiver(address)
address_8 = RemoteReceiver(address)
ax_args_2 = RemoteReceiver(ax_args)
address_9 = RemoteReceiver(address)
address_10 = RemoteReceiver(address)
address_11 = RemoteReceiver(address)
fig_size_2 = RemoteReceiver(fig_size)
ax_args_3 = RemoteReceiver(ax_args)
data_4 = RemoteReceiver(data)
despine_4 = RemoteReceiver(despine_2)
address_12 = RemoteReceiver(address)
data_5 = RemoteReceiver(data)
despine_5 = RemoteReceiver(despine_2)
data_6 = RemoteReceiver(data)
despine_6 = RemoteReceiver(despine_2)
data_7 = RemoteReceiver(data)
data_8 = RemoteReceiver(data)
data_9 = RemoteReceiver(data)
ax_args_4 = RemoteReceiver(ax_args)
data_10 = RemoteReceiver(data)
data_11 = RemoteReceiver(data)
ax_args_5 = RemoteReceiver(ax_args)
ax_args_6 = RemoteReceiver(ax_args)
ax_args_7 = RemoteReceiver(ax_args)
ax_args_8 = RemoteReceiver(ax_args)
despine_7 = RemoteReceiver(despine_2)
despine_8 = RemoteReceiver(despine_2)
ax_args_9 = RemoteReceiver(ax_args)
despine_9 = RemoteReceiver(despine_2)
ax_args_10 = RemoteReceiver(ax_args)
despine_10 = RemoteReceiver(despine_2)
despine_11 = RemoteReceiver(despine_2)
data_12 = RemoteReceiver(data)
fig_size_3 = RemoteReceiver(fig_size)
concat_3 = Concatenate(FragmentA=address_5, FragmentB=list_11)
hops_3 = Hops(
    _Path=concat_3,
    Dataframe=data_5,
    XAxis="t_dry",
    YAxis="season",
    Col_wrap=-999,
    CoinfidenceInterval="None",
    Seed=2,
    Kind="box",
    Palette="turbo",
    FigureSize=fig_size_2,
    Despine=despine_3,
    AdditionalArguments="{}",
    AxisArguments=ax_args_3,
    Plot=toggle_6,
    CacheResultsInMemory=False,
    CacheSolveResults=False,
    RemoteDefinitionLocation="http://127.0.0.1:8000/catplot",
    RemoteSolveVersion=(0, 1, 0),
    ShowInput_Enabled=False,
    ShowInput_Path=True,
    SynchronousSolve=False)
concat_4 = Concatenate(FragmentA=address_4, FragmentB=list_3)
hops_4 = Hops(
    _Path=concat_4,
    Dataframe=data_12,
    XAxis="drybulb",
    YAxis="season",
    Jitter=1,
    Marker_size=2,
    Palette="deep",
    FigureSize=fig_size_3,
    Despine=despine_9,
    AdditionalArguments="{}",
    AxisArguments=ax_args_10,
    Plot=toggle_10,
    CacheResultsInMemory=False,
    CacheSolveResults=False,
    RemoteDefinitionLocation="http://127.0.0.1:8000/stripplot",
    RemoteSolveVersion=(0, 1, 0),
    ShowInput_Enabled=False,
    ShowInput_Path=True,
    SynchronousSolve=False)
concat_5 = Concatenate(FragmentA=address_6, FragmentB=list_4)
hops_5 = Hops(
    _Path=concat_5,
    Dataframe=data_4,
    XAxis="drybulb",
    YAxis="season",
    Dodge=False,
    Marker_size=2,
    Palette="deep",
    Despine=despine_5,
    AdditionalArguments="{}",
    AxisArguments=ax_args_6,
    Plot=toggle_9,
    CacheResultsInMemory=False,
    CacheSolveResults=False,
    RemoteDefinitionLocation="http://127.0.0.1:8000/swarmplot",
    RemoteSolveVersion=(0, 1, 0),
    ShowInput_Enabled=False,
    ShowInput_Path=True,
    SynchronousSolve=False)
concat_6 = Concatenate(FragmentA=address_7, FragmentB=list_5)
hops_6 = Hops(
    _Path=concat_6,
    Dataframe=data_6,
    XAxis="drybulb",
    YAxis="season",
    Palette="deep",
    Despine=despine_6,
    AdditionalArguments="{}",
    AxisArguments=ax_args_7,
    Plot=toggle_7,
    CacheResultsInMemory=False,
    CacheSolveResults=False,
    RemoteDefinitionLocation="http://127.0.0.1:8000/boxplot",
    RemoteSolveVersion=(0, 1, 0),
    ShowInput_Enabled=False,
    ShowInput_Path=True,
    SynchronousSolve=False)
concat_7 = Concatenate(FragmentA=address_8, FragmentB=list_6)
hops_7 = Hops(
    _Path=concat_7,
    Dataframe=data_7,
    XAxis="drybulb",
    YAxis="season",
    Bw=1,
    Inner="box",
    Split=False,
    Dodge=True,
    Palette="deep",
    Despine=despine_4,
    AdditionalArguments="{}",
    AxisArguments=ax_args_2,
    Plot=toggle_2,
    CacheResultsInMemory=False,
    CacheSolveResults=False,
    RemoteDefinitionLocation="http://127.0.0.1:8000/violinplot",
    RemoteSolveVersion=(0, 1, 0),
    ShowInput_Enabled=False,
    ShowInput_Path=True,
    SynchronousSolve=False)
concat_8 = Concatenate(FragmentA=address_9, FragmentB=list_7)
hops_8 = Hops(
    _Path=concat_8,
    Dataframe=data_8,
    XAxis="drybulb",
    YAxis="season",
    Dodge=True,
    KDepth="tukey",
    Fliers=True,
    Palette="deep",
    Despine=despine_10,
    AdditionalArguments="{}",
    AxisArguments=ax_args_8,
    Plot=toggle_8,
    CacheResultsInMemory=False,
    CacheSolveResults=False,
    RemoteDefinitionLocation="http://127.0.0.1:8000/boxenplot",
    RemoteSolveVersion=(0, 1, 0),
    ShowInput_Enabled=False,
    ShowInput_Path=True,
    SynchronousSolve=False)
concat_9 = Concatenate(FragmentA=address_12, FragmentB=list_8)
hops_9 = Hops(
    _Path=concat_9,
    Dataframe=data_9,
    XAxis="season",
    YAxis="drybulb",
    Dodge=False,
    Join=True,
    Scale=1,
    ErrorWidth=0,
    Palette="deep",
    Despine=despine_7,
    AdditionalArguments="{}",
    AxisArguments=ax_args_4,
    Plot=toggle_3,
    CacheResultsInMemory=False,
    CacheSolveResults=False,
    RemoteDefinitionLocation="http://127.0.0.1:8000/pointplot",
    RemoteSolveVersion=(0, 1, 0),
    ShowInput_Enabled=False,
    ShowInput_Path=True,
    SynchronousSolve=False)
concat_10 = Concatenate(FragmentA=address_10, FragmentB=list_9)
hops_10 = Hops(
    _Path=concat_10,
    Dataframe=data_10,
    XAxis="drybulb",
    YAxis="season",
    ConfidenceInterval="sd",
    ErrorWidth=0,
    Palette="deep",
    Despine=despine_8,
    AdditionalArguments="{}",
    AxisArguments=ax_args_9,
    Plot=toggle_4,
    CacheResultsInMemory=False,
    CacheSolveResults=False,
    RemoteDefinitionLocation="http://127.0.0.1:8000/barplot",
    RemoteSolveVersion=(0, 1, 0),
    ShowInput_Enabled=False,
    ShowInput_Path=True,
    SynchronousSolve=False)
concat_11 = Concatenate(FragmentA=address_11, FragmentB=list_10)
hops_11 = Hops(
    _Path=concat_11,
    Dataframe=data_11,
    XAxis="season",
    Dodge=True,
    Palette="deep",
    Despine=despine_11,
    AdditionalArguments="{}",
    AxisArguments=ax_args_5,
    Plot=toggle_5,
    CacheResultsInMemory=False,
    CacheSolveResults=False,
    RemoteDefinitionLocation="http://127.0.0.1:8000/countplot",
    RemoteSolveVersion=(0, 1, 0),
    ShowInput_Enabled=False,
    ShowInput_Path=True,
    SynchronousSolve=False)
str2img = DeserializeImageFromString(ImageString=hops_3)
str2img_2 = DeserializeImageFromString(ImageString=hops_4)
str2img_3 = DeserializeImageFromString(ImageString=hops_5)
str2img_4 = DeserializeImageFromString(ImageString=hops_6)
str2img_5 = DeserializeImageFromString(ImageString=hops_7)
str2img_6 = DeserializeImageFromString(ImageString=hops_8)
str2img_7 = DeserializeImageFromString(ImageString=hops_9)
str2img_8 = DeserializeImageFromString(ImageString=hops_10)
str2img_9 = DeserializeImageFromString(ImageString=hops_11)
image_resource = ImageResource(str2img)
panel_11 = Panel("""{"alpha":0.5,
"marker":"v", 
"edgecolors":"r"}""")
panel_12 = Panel("direct_normal_rad")
panel_13 = Panel("scatter")
python = GhPythonScript(python_dict=panel_11)  # -> json
# ---------- python: Python ----------
__author__ = "pablo"
__version__ = "2022.09.04"

import rhinoscriptsyntax as rs
import json
import ast

json = json.dumps(ast.literal_eval(python_dict))
# ---------- end python ----------
panel_14 = Panel("6;4")
panel_15 = Panel(python)

# ---- group: run.
toggle_11 = BooleanToggle(False)

toggle_12 = BooleanToggle(False)

# ----
list_12 = ValueList({"catplot", "stripplot", "swarmplot", "boxplot", "violinplot", "boxenplot", "pointplot", "barplot", "countplot", "displot", "histplot", "kdeplot", "lineplot", "relplot", "scatterplot"}, selected="relplot")
list_13 = ValueList({"catplot", "stripplot", "swarmplot", "boxplot", "violinplot", "boxenplot", "pointplot", "barplot", "countplot", "displot", "histplot", "kdeplot", "lineplot", "relplot", "scatterplot"}, selected="lineplot")
list_14 = ValueList({"catplot", "stripplot", "swarmplot", "boxplot", "violinplot", "boxenplot", "pointplot", "barplot", "countplot", "displot", "histplot", "kdeplot", "lineplot", "relplot", "scatterplot"}, selected="scatterplot")
panel_16 = Panel("season")
# RELATIONAL
address_13 = RemoteReceiver(address)
despine_12 = RemoteReceiver(despine_2)
ax_args_11 = RemoteReceiver(ax_args)
address_14 = RemoteReceiver(address)
address_15 = RemoteReceiver(address)
fig_size_4 = RemoteReceiver(fig_size)
despine_13 = RemoteReceiver(despine_2)
ax_args_12 = RemoteReceiver(ax_args)
despine_14 = RemoteReceiver(despine_2)
ax_args_13 = RemoteReceiver(ax_args)
data_13 = RemoteReceiver(data)
data_14 = RemoteReceiver(data)
data_15 = RemoteReceiver(data)
panel_17 = Panel("2")
concat_12 = Concatenate(FragmentA=address_13, FragmentB=list_12)
hops_12 = Hops(
    _Path=concat_12,
    Dataframe=data_13,
    XAxis="dir_norm_rad",
    YAxis="t_dry",
    Hue="season",
    Size="t_dry",
    Col_wrap=-999,
    Kind="scatter",
    Palette="deep",
    FigureSize=fig_size_4,
    Despine=despine_13,
    AdditionalArguments="{}",
    AxisArguments=ax_args_12,
    Plot=Toggle(True),
    CacheResultsInMemory=True,
    CacheSolveResults=True,
    RemoteDefinitionLocation="http://127.0.0.1:8000/relplot",
    RemoteSolveVersion=(0, 1, 0),
    ShowInput_Enabled=False,
    ShowInput_Path=True,
    SynchronousSolve=False)
concat_13 = Concatenate(FragmentA=address_14, FragmentB=list_13)
hops_13 = Hops(
    _Path=concat_13,
    Dataframe=data_14,
    XAxis="hour",
    YAxis="drybulb",
    Palette="deep",
    Despine=despine_14,
    AdditionalArguments="{}",
    AxisArguments=ax_args_13,
    Plot=toggle_12,
    CacheResultsInMemory=False,
    CacheSolveResults=False,
    RemoteDefinitionLocation="http://127.0.0.1:8000/lineplot",
    RemoteSolveVersion=(0, 1, 0),
    ShowInput_Enabled=False,
    ShowInput_Path=True,
    SynchronousSolve=False)
concat_14 = Concatenate(FragmentA=address_15, FragmentB=list_14)
hops_14 = Hops(
    _Path=concat_14,
    Dataframe=data_15,
    XAxis="direct_normal_rad",
    YAxis="drybulb",
    Hue="season",
    Palette="deep",
    Despine=despine_12,
    AdditionalArguments=python,
    AxisArguments=ax_args_11,
    Plot=toggle_11,
    CacheResultsInMemory=False,
    CacheSolveResults=False,
    RemoteDefinitionLocation="http://127.0.0.1:8000/scatterplot",
    RemoteSolveVersion=(0, 1, 0),
    ShowInput_Enabled=False,
    ShowInput_Path=True,
    SynchronousSolve=False)
str2img_10 = DeserializeImageFromString(ImageString=hops_13)
str2img_11 = DeserializeImageFromString(ImageString=hops_14)
str2img_12 = DeserializeImageFromString(ImageString=hops_12)
image_resource_2 = ImageResource(str2img_12)

# ---- group: run.
toggle_13 = BooleanToggle(True)

toggle_14 = BooleanToggle(False)

# ----
toggle_15 = BooleanToggle(True)

# ---- group: run.
toggle_16 = BooleanToggle(False)

# ----
list_15 = ValueList({"catplot", "stripplot", "swarmplot", "boxplot", "violinplot", "boxenplot", "pointplot", "barplot", "countplot", "displot", "histplot", "kdeplot", "lineplot", "relplot", "scatterplot"}, selected="displot")
list_16 = ValueList({"catplot", "stripplot", "swarmplot", "boxplot", "violinplot", "boxenplot", "pointplot", "barplot", "countplot", "displot", "histplot", "kdeplot", "lineplot", "relplot", "scatterplot"}, selected="histplot")
list_17 = ValueList({"catplot", "stripplot", "swarmplot", "boxplot", "violinplot", "boxenplot", "pointplot", "barplot", "countplot", "displot", "histplot", "kdeplot", "lineplot", "relplot", "scatterplot"}, selected="kdeplot")
# DISTRIBUTION
address_16 = RemoteReceiver(address)
address_17 = RemoteReceiver(address)
address_18 = RemoteReceiver(address)
despine_15 = RemoteReceiver(despine_2)
ax_args_14 = RemoteReceiver(ax_args)
despine_16 = RemoteReceiver(despine_2)
ax_args_15 = RemoteReceiver(ax_args)
ax_args_16 = RemoteReceiver(ax_args)
fig_size_5 = RemoteReceiver(fig_size)
despine_17 = RemoteReceiver(despine_2)
data_16 = RemoteReceiver(data)
data_17 = RemoteReceiver(data)
data_18 = RemoteReceiver(data)
panel_19 = Panel("0.25")
concat_15 = Concatenate(FragmentA=address_16, FragmentB=list_15)
hops_15 = Hops(
    _Path=concat_15,
    Dataframe=data_18,
    XAxis="t_dry",
    Hue="season",
    Col_wrap=-999,
    Kind="kde",
    Rug=False,
    Legend=True,
    Palette="deep",
    FigureSize=fig_size_5,
    Despine=despine_17,
    AdditionalArguments="{}",
    AxisArguments=ax_args_14,
    Plot=toggle_13,
    CacheResultsInMemory=False,
    CacheSolveResults=False,
    RemoteDefinitionLocation="http://127.0.0.1:8000/displot",
    RemoteSolveVersion=(0, 1, 0),
    ShowInput_Enabled=False,
    ShowInput_Path=True,
    SynchronousSolve=False)
concat_16 = Concatenate(FragmentA=address_17, FragmentB=list_16)
hops_16 = Hops(
    _Path=concat_16,
    Dataframe=data_16,
    XAxis="drybulb",
    Hue="season",
    Stat="count",
    Cumulative=Toggle(False),
    Multiple="stack",
    Element="bars",
    Fill=True,
    Shrink=1,
    KDE=False,
    Legend=True,
    Palette="deep",
    Despine=despine_16,
    AdditionalArguments="{}",
    AxisArguments=ax_args_15,
    Plot=toggle_14,
    CacheResultsInMemory=False,
    CacheSolveResults=False,
    RemoteDefinitionLocation="http://127.0.0.1:8000/histplot",
    RemoteSolveVersion=(0, 1, 0),
    ShowInput_Enabled=False,
    ShowInput_Path=True,
    SynchronousSolve=False)
concat_17 = Concatenate(FragmentA=address_18, FragmentB=list_17)
hops_17 = Hops(
    _Path=concat_17,
    Dataframe=data_17,
    XAxis="direct_normal_rad",
    YAxis="drybulb",
    Hue="season",
    Cut=3,
    Cumulative=False,
    Multiple="layer",
    CommonNorm=True,
    CommonGrid=False,
    Levels=10,
    Thresh=0.05,
    Alpha=1,
    Fill=False,
    Legend=True,
    Palette="deep",
    Despine=despine_15,
    AdditionalArguments="{}",
    AxisArguments=ax_args_16,
    Plot=toggle_16,
    CacheResultsInMemory=False,
    CacheSolveResults=False,
    RemoteDefinitionLocation="http://127.0.0.1:8000/kdeplot",
    RemoteSolveVersion=(0, 1, 0),
    ShowInput_Enabled=False,
    ShowInput_Path=True,
    SynchronousSolve=False)
str2img_13 = DeserializeImageFromString(ImageString=hops_15)
str2img_14 = DeserializeImageFromString(ImageString=hops_16)
str2img_15 = DeserializeImageFromString(ImageString=hops_17)
image_resource_3 = ImageResource(str2img_13)
panel_20 = Panel("{\"palette\" : \"turbo\"}")

# ---- group: run.
toggle_17 = BooleanToggle(True)

# ----
list_18 = ValueList({"catplot", "stripplot", "swarmplot", "boxplot", "violinplot", "boxenplot", "pointplot", "barplot", "countplot", "displot", "histplot", "kdeplot", "lineplot", "relplot", "scatterplot", "pairplot", "jointplot"}, selected="jointplot")
# JOINT PLOT
address_19 = RemoteReceiver(address)
data_19 = RemoteReceiver(data)
fig_size_6 = RemoteReceiver(fig_size)
ax_args_17 = RemoteReceiver(ax_args)
despine_18 = RemoteReceiver(despine_2)
panel_22 = Panel("turbo")
concat_18 = Concatenate(FragmentA=address_19, FragmentB=list_18)
hops_18 = Hops(
    _Path=concat_18,
    Dataframe=data_19,
    XAxis="t_dry",
    YAxis="wind_speed",
    Kind="hex",
    Palette="deep",
    Despine=despine_18,
    AdditionalArguments="{}",
    AxisArguments="{}",
    Plot=toggle_17,
    CacheResultsInMemory=False,
    CacheSolveResults=False,
    RemoteDefinitionLocation="http://127.0.0.1:8000/jointplot",
    RemoteSolveVersion=(0, 1, 0),
    ShowInput_Enabled=False,
    ShowInput_Path=True,
    SynchronousSolve=False)
str2img_16 = DeserializeImageFromString(ImageString=hops_18)
image_resource_4 = ImageResource(str2img_16)
panel_23 = Panel("""wind_speed
t_dry
t_dew
dir_hor_rad""")
ax_args_18 = RemoteReceiver(ax_args)
panel_24 = Panel("wind_speed")

# ---- group: run.
toggle_18 = BooleanToggle(False)

# ----
list_19 = ValueList({"catplot", "stripplot", "swarmplot", "boxplot", "violinplot", "boxenplot", "pointplot", "barplot", "countplot", "displot", "histplot", "kdeplot", "lineplot", "relplot", "scatterplot", "pairplot", "jointplot"}, selected="pairplot")
panel_26 = Panel("t_dry")
# PAIR PLOT
address_20 = RemoteReceiver(address)
data_20 = RemoteReceiver(data)
fig_size_7 = RemoteReceiver(fig_size)
despine_19 = RemoteReceiver(despine_2)
panel_27 = Panel("hex")
concat_19 = Concatenate(FragmentA=address_20, FragmentB=list_19)
hops_19 = Hops(
    _Path=concat_19,
    Dataframe=data_20,
    Palette="turbo",
    Vars=panel_23,
    XVariables="[]",
    YVariables="[]",
    Kind="scatter",
    DiagramKind="auto",
    CornerPlot=False,
    FigureSize="10;10",
    Despine="{}",
    AdditionalArguments="{}",
    AxisArguments="{}",
    Plot=toggle_18,
    CacheResultsInMemory=True,
    CacheSolveResults=True,
    RemoteDefinitionLocation="http://127.0.0.1:8000/pairplot",
    RemoteSolveVersion=(0, 1, 0),
    ShowInput_Enabled=False,
    ShowInput_Path=True,
    SynchronousSolve=True)
str2img_17 = DeserializeImageFromString(ImageString=hops_19)
# FIGURE
# LEVEL
image_resource_5 = ImageResource(str2img_17)

# ==== cluster Cluster
city = ClusterInput()
new_york = Text("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")
london = Text("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")
sydney = Text("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")
berlin = Text("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")
medellin = Text("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")
merge = Merge(Data1=london, Data2=new_york, Data3=sydney, Data4=medellin, Data5=berlin)
city_2 = Integer(city)
item = ListItem(List=merge, Index=city_2, Wrap=True)
sample_csv_data = Text(item)
sample_csv_data_2 = ClusterOutput(sample_csv_data)
